# Grasshopper definition DAGAN-GH.gh (Grasshopper 1.0.7)
# plug-ins: Owl.GH, Squid (ShapeDiver Edition)

pipeline = GeometryPipeline(
    GroupByLayer=False,
    GroupByType=False,
    IncludeHidden=True,
    IncludeLocked=True,
    LayerFilter="filter3",
    NameFilter="*",
    SublayerFiltering=True,
    TypeFilter=4)
pipeline_2 = GeometryPipeline(
    GroupByLayer=False,
    GroupByType=False,
    IncludeHidden=True,
    IncludeLocked=True,
    LayerFilter="filter2",
    NameFilter="*",
    SublayerFiltering=True,
    TypeFilter=4)
pipeline_3 = GeometryPipeline(
    GroupByLayer=False,
    GroupByType=False,
    IncludeHidden=True,
    IncludeLocked=True,
    LayerFilter="filter4",
    NameFilter="*",
    SublayerFiltering=True,
    TypeFilter=4)
pipeline_4 = GeometryPipeline(
    GroupByLayer=False,
    GroupByType=False,
    IncludeHidden=True,
    IncludeLocked=True,
    LayerFilter="filter1",
    NameFilter="*",
    SublayerFiltering=True,
    TypeFilter=4)
pipeline_5 = GeometryPipeline(
    GroupByLayer=False,
    GroupByType=False,
    IncludeHidden=True,
    IncludeLocked=True,
    LayerFilter="filter0",
    NameFilter="*",
    SublayerFiltering=True,
    TypeFilter=4)
button = Button()
cluster = Cluster(crv=pipeline_2, C=ColourSwatch(SwatchColor=RGB(255, 255, 255)), F=Slider(3.084, range=0..10))
cluster_2 = Cluster(crv=pipeline_5, C=ColourSwatch(SwatchColor=RGB(71, 71, 255)), F=Slider(1.382, range=0..10))
cluster_3 = Cluster(crv=pipeline_4, C=ColourSwatch(SwatchColor=RGB(0, 158, 5)), F=Slider(2.5, range=0..10))
cluster_4 = Cluster(crv=pipeline, C=ColourSwatch(SwatchColor=RGB(219, 0, 0)), F=Slider(4.149, range=0..10))
cluster_5 = Cluster(crv=pipeline_3, C=ColourSwatch(SwatchColor=RGB(163, 0, 0)), F=Slider(4.634, range=0..10))
mesh = Mesh(cluster)
mesh_2 = Mesh(cluster_5)
mesh_3 = Mesh(cluster_2)
mesh_4 = Mesh(cluster_3)
mesh_5 = Mesh(cluster_4)
dagan_directory = FilePath("C:\Users\samra\Desktop\DAGAN\")
viewport_exporter = CSharpScript(
    iDAGANdir=dagan_directory,
    iFileName="0.png",
    iViewportName="Front",
    Capture=button,
    Reference=["C:\Users\samra\Desktop\temp\New folder\KGySoft.Drawing_Binaries\net45\KGySoft.Drawing.dll", "C:\Users\samra\Desktop\temp\New folder\KGySoft.Drawing_Binaries\net45\KGySoft.CoreLibraries.dll"])  # -> out, A; inputs iDAGANdir: String, iFileName: String, iViewportName: String, Capture: Boolean
# ---------- viewport_exporter: C# usings ----------
using System.IO;
using System.Linq;
using System.Data;
using System.Drawing;
using System.Drawing.Imaging;
using System.Reflection;
using System.Windows.Forms;
using System.Xml;
using System.Xml.Linq;
using System.Runtime.InteropServices;

using Rhino.DocObjects;
using Rhino.Collections;
using GH_IO;
using GH_IO.Serialization;
using KGySoft.Drawing;
using KGySoft.Drawing.Imaging;
# ---------- viewport_exporter: C# ----------
    if (!Capture) return;
    if (string.IsNullOrWhiteSpace(iDAGANdir)) return;
    if (string.IsNullOrWhiteSpace(iFileName)) return;


    if (!iDAGANdir.EndsWith(System.IO.Path.DirectorySeparatorChar.ToString()))
      iDAGANdir += System.IO.Path.DirectorySeparatorChar;

    if (!System.IO.Directory.Exists(iDAGANdir))
      return;


    string fileName = iDAGANdir + "datasets/facades/val_label/" + string.Format(iFileName, 0);


    Rhino.Display.RhinoView view = RhinoDocument.Views.Find(iViewportName, false);
    Bitmap orig = new Bitmap(iDAGANdir + "datasets/facades/val_img/0.jpg");
    Bitmap image = new Bitmap(view.CaptureToBitmap(false, false, false), orig.Width, orig.Height);
    

    image.Save(fileName);
    image.Dispose();
    A = fileName;
# ---------- end viewport_exporter ----------
dagan = RunProcess(
    Application="C:\Windows\system32\cmd.exe",
    Commands=["conda activate CNTK", "cd C:\Users\samra\Desktop\DAGAN\datasets\facades\val_label", "python convert.py", "cd C:\Users\samra\Desktop\DAGAN", "python test.py --name GauGAN_DAGAN_facades --dataset_mode facades --dataroot ./datasets/facades --gpu_ids 0 --results_dir ./results --checkpoints_dir ./checkpoints --batchSize 1 --which_epoch 100"],
    Windowed=False,
    Run=button,
    OutputText=True)  # -> Done, Output
panel = Panel(dagan.Output)
visualizer = CSharpScript(iDAGANdir=dagan_directory, iRun=dagan.Done)  # -> out, A; inputs iDAGANdir: String, iRun: Boolean
# ---------- visualizer: C# usings ----------
using System.IO;
using System.Linq;
using System.Text;
using System.Threading.Tasks;
using System.Drawing;
using System.Drawing.Imaging;
# ---------- visualizer: C# ----------
    if (iRun)
    {
      string fileLocation = "/results/GauGAN_DAGAN_facades/test_100/images/synthesized_image/";
      string copied = "/showAll/";
      var files = new DirectoryInfo(iDAGANdir + fileLocation).GetFiles("*.*");
      string latestfile = "";
      DateTime lastupdated = DateTime.MinValue;
      foreach (FileInfo file in files)
      {
        if (file.LastWriteTime > lastupdated)
        {
          lastupdated = file.LastWriteTime;
          latestfile = file.Name;
        }
      }
      int ran = rnd.Next(1, 100000);
      string generated = iDAGANdir + fileLocation + latestfile;

      string showall = iDAGANdir + copied + ran.ToString() + ".png";
      File.Copy(generated, showall, true);
      A = showall;
    }
# ---------- visualizer: C# additional code ----------
  Random rnd = new Random();
# ---------- end visualizer ----------
read_images = Read(Path=visualizer.A)  # -> Bitmap, Bounds
qpreview = QuickPreview(Bitmap=read_images.Bitmap)

# ==== cluster Cluster
crv = ClusterInput()
F = ClusterInput()
crv_2 = Curve(crv)
Y = UnitY(Factor=F)
boundary = BoundarySurfaces(Edges=crv_2)
rev = Reverse(Vector=Y)
extr = Extrude(Base=boundary, Direction=rev)
mesh = MeshBrep(
    Brep=extr,
    Settings={GridMaxCount=0, GridMinCount=16, JaggedSeams=False, MaxEdgeLength=0, MinEdgeLength=0.0001, MinTolerance=0, Refine=True, RefineAngle=0, RelativeTolerance=0.65, SimplePlanes=True, Tolerance=0})
C = ClusterInput()
mcol = MeshColours(Mesh=mesh, Colours=C)
M = ClusterOutput(mcol)
